# Grasshopper definition WavePatternFromSurface.gh (Grasshopper 1.0.8)
# This is Grasshopper definition that divides a surface into a same number of points in U and V direction. Then offsets those points on the Z axis to generare a wavy pattern. After that, a surface is created out of the offseted points and extruded.

surface = GetGeometry(
    AnnotationTypeFilter=0,
    AtLeast=1,
    AtMost=1,
    DeleteInput=False,
    Filter=8,
    Prompt="Surface to create a wavy shape from.",
    TreeAccess=False)
surface_2 = Surface(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)  # disabled
number_slider = Slider(89, range=1..100)
surface_3 = Surface(surface)
divide_surface = DivideSurface(Surface=surface_3, UCount=number_slider, VCount=number_slider)  # -> Points, Normals, Parameters
point = Point(flatten(divide_surface.Points))
deconstruct = Deconstruct(Point=point)  # -> XComponent, YComponent, ZComponent
multiplication = Multiplication(A=Slider(2, range=0..10), B=Slider(360, range=0..1000))
y = Data(deconstruct.YComponent)
x = Data(deconstruct.XComponent)
multiplication_2 = Multiplication(A=Slider(3, range=0..10), B=Slider(180, range=0..1000))
bounds = Bounds(Numbers=y)
construct_domain = ConstructDomain(DomainStart=0, DomainEnd=multiplication_2)
bounds_2 = Bounds(Numbers=x)
construct_domain_2 = ConstructDomain(DomainStart=0, DomainEnd=multiplication)
remap_numbers = RemapNumbers(Value=y, Source=bounds, Target=construct_domain)  # -> Mapped, Clipped
remap_numbers_2 = RemapNumbers(Value=x, Source=bounds_2, Target=construct_domain_2)  # -> Mapped, Clipped
radians = Radians(Degrees=remap_numbers.Mapped)
radians_2 = Radians(Degrees=remap_numbers_2.Mapped)
number_slider_2 = Slider(21, range=0..100)
sine = Sine(Value=radians)
sine_2 = Sine(Value=radians_2)
multiplication_3 = Multiplication(A=sine, B=number_slider_2)
multiplication_4 = Multiplication(A=sine_2, B=number_slider_2)
multiplication_5 = Multiplication(A=multiplication_4, B=multiplication_3)
unit_z = UnitZ(Factor=multiplication_5)
move = Move(Geometry=point, Motion=unit_z)  # -> Geometry, Transform
integer = Integer(number_slider)
addition = Addition(A=integer, B=1)
unit_z_2 = UnitZ(Factor="20")
surface_from_points = SurfaceFromPoints(Points=move.Geometry, UCount=addition, Interpolate=False)
extrude = Extrude(Base=surface_from_points, Direction=unit_z_2)
context_bake = ContextBake(Content=extrude)
